# Dynamo graph Close Gaps.dyn (Dynamo 2.0.2.6826)

code_block = CodeBlock { "Lines"; }
get_line_style_by_name = Custom[Get Line Style by Name](Name=code_block)  # This node will return a line style object by its name. Line styles can be either Drafting or Model Line Property.
code_block_2 = CodeBlock { "3"; }
byJoinedCurves = PolyCurve.ByJoinedCurves(joinTolerance=code_block_2)  # unwired: curves
curves = PolyCurve.Curves(polyCurve=byJoinedCurves)
watch = Watch(curves)
watch_2 = Watch(byJoinedCurves)
select_model_lines_by_style = Custom[Select Model Lines by Style](Style_Name=code_block)  # This node will select all model lines in the revit project by a line style name.
curve = CurveElement.Curve(curveElement=select_model_lines_by_style)
watch_3 = Watch(curve)
flatten = List.Flatten(list=curve)
deconstruct = List.Deconstruct(list=flatten)
join = Curve.Join(curve=deconstruct.first, curves=deconstruct.rest)
watch_4 = Watch(join)
number_slider = DoubleSlider(2, range=0..777 step 0.1)
translate = Geometry.Translate(geometry=watch_4, xTranslation=number_slider)
watch_5 = Watch(translate)
watch_6 = Watch(flatten)
watch_7 = Watch(deconstruct.first)
watch_8 = Watch(deconstruct.rest)
group_curves = Custom[Group Curves](Curves=curve)  # This node will take any input of flat list of curves and group them into sublists containing "joinable" curves that is continous curves. They might form closed curves or open curves. Use PolyCurve.ByJoinedCurves to convert output groups of curves into single PolyCurves
watch_9 = Watch(group_curves)
geometry = Element.Geometry(element=select_model_lines_by_style)
flatten_2 = List.Flatten(list=geometry)
group_curves_2 = Custom[Group Curves](Curves=flatten_2)
curves_2 = PolyCurve.Curves(polyCurve=group_curves_2)
watch_10 = Watch(curves_2)
watch_11 = Watch(geometry)
watch_12 = Watch(flatten_2)
watch_13 = Watch(group_curves_2)
curves_3 = Element.Curves(element=group_curves_2)
watch_14 = Watch(curves_3)
curves_4 = Element.Curves(element=select_model_lines_by_style)
watch_15 = Watch(curves_4)
