# Dynamo graph Lines with gap to polycurve.dyn (Dynamo 2.0.2.6826)

code_block = CodeBlock { "Lines"; }
get_line_style_by_name = Custom[Get Line Style by Name](Name=code_block)  # This node will return a line style object by its name. Line styles can be either Drafting or Model Line Property.
flatten = List.Flatten()  # unwired: list
number_slider = DoubleSlider(1, range=0..100 step 0.1)
byJoinedCurves = PolyCurve.ByJoinedCurves(curves=flatten, joinTolerance=number_slider)
watch = Watch(byJoinedCurves)
select_model_lines_by_style = Custom[Select Model Lines by Style](Style_Name=code_block)  # This node will select all model lines in the revit project by a line style name.
geometry = Element.Geometry(element=select_model_lines_by_style)
watch_2 = Watch(geometry)
watch_3 = Watch(flatten)
number_slider_2 = DoubleSlider(2, range=0..100 step 0.1)
translate = Geometry.Translate(geometry=byJoinedCurves, xTranslation=number_slider_2)
curves = PolyCurve.Curves(polyCurve=byJoinedCurves)
getLocation = Element.GetLocation(element=select_model_lines_by_style)
code_block_2 = CodeBlock { 0.03; }
groupByDistance = Custom[Springs.Geometry.GroupByDistance](geometry=getLocation, margin=code_block_2)  # Splits the list of geometry elements into groups if the distance between them is less than the provided margin.
merge = Custom[Springs.LineLoop.Merge](lines=groupByDistance)  # Attempts to join lines into a single chain of joined curves. The node returns the new lines as a chain and with the original order. The success outputs returns the success of the execution as a true/false boolean.
translate_2 = Geometry.Translate(geometry=merge.lines, xTranslation=number_slider_2)
