# Dynamo graph Bidirectional_Test.dyn (Dynamo 1.2.1.3083)

file_path = Filename(".\Birdirectional_Test.csv")
categories = Categories("Rooms")
all_elements_of_category = ElementsOfCategory(categories)
string = StringInput("Name")
getParameterValueByName = Element.GetParameterValueByName(element=all_elements_of_category, parameterName=string)
string_2 = StringInput("Number")
getParameterValueByName_2 = Element.GetParameterValueByName(element=all_elements_of_category, parameterName=string_2)
create = List.Create(getParameterValueByName, getParameterValueByName_2)
transpose = List.Transpose(create)
writeToFile = CSV.WriteToFile(file_path, transpose)
fromPath = FileObject(file_path)  # "File.FromPath"
readFromFile = CSV.ReadFromFile(fromPath)
transpose_2 = List.Transpose(readFromFile)
number = DoubleInput(0)
getItemAtIndex = List.GetItemAtIndex(list=transpose_2, index=number)
setParameterByName = Element.SetParameterByName(element=all_elements_of_category, parameterName=string, value=getItemAtIndex)
number_2 = DoubleInput(1)
getItemAtIndex_2 = List.GetItemAtIndex(list=transpose_2, index=number_2)
string_from_object = FromObject(getItemAtIndex_2)
setParameterByName_2 = Element.SetParameterByName(element=all_elements_of_category, parameterName=string_2, value=string_from_object)
