# Dynamo graph Doors.dyn (Dynamo 1.2.1.3083)

file_path = Filename(".\Doors.csv")
string = StringInput("Mark")
string_2 = StringInput("Type Mark")
string_3 = StringInput("Width")
string_4 = StringInput("Height")
string_5 = StringInput("Thickness")
string_6 = StringInput("DS_Door_Type_(SFT)")
string_7 = StringInput("DS_Door_Material_(SFT)")
string_8 = StringInput("DS_Door_Finish_(SFT)")
string_9 = StringInput("DS_Fire_Rating_(SFT)")
string_10 = StringInput("DS_Frame_Type_(SFT)")
string_11 = StringInput("DS_Frame_Material_(SFT)")
string_12 = StringInput("DS_Frame_Finish_(SPI)")
string_13 = StringInput("DS_Frame_Detail_Head_(SPI)")
string_14 = StringInput("DS_Frame_Detail_Jamb_(SPI)")
string_15 = StringInput("DS_Frame_Detail_Sill_(SPI)")
string_16 = StringInput("DS_Fire_Rating_(SFT)")
string_17 = StringInput("DS_Hardware_Set_(SFT)")
string_18 = StringInput("DS_Notes_(SPI)")
create = List.Create(string, string_2, string_3, string_4, string_5, string_6, string_7, string_8, string_9, string_10, string_11, string_12, string_13, string_14, string_15, string_16, string_17, string_18)
categories = Categories("Doors")
all_elements_of_category = ElementsOfCategory(categories)
getParameterValueByName = Element.GetParameterValueByName(element=all_elements_of_category, parameterName=string)
type = Archilab.Grimshaw.Elements.Element.Type(all_elements_of_category)
getParameterValueByName_2 = Element.GetParameterValueByName(element=type, parameterName=string_2)
getParameterValueByName_3 = Element.GetParameterValueByName(element=type, parameterName=string_3)
getParameterValueByName_4 = Element.GetParameterValueByName(element=type, parameterName=string_4)
getParameterValueByName_5 = Element.GetParameterValueByName(element=type, parameterName=string_5)
getParameterValueByName_6 = Element.GetParameterValueByName(element=type, parameterName=string_6)
getParameterValueByName_7 = Element.GetParameterValueByName(element=type, parameterName=string_7)
getParameterValueByName_8 = Element.GetParameterValueByName(element=type, parameterName=string_8)
getParameterValueByName_9 = Element.GetParameterValueByName(element=type, parameterName=string_9)
getParameterValueByName_10 = Element.GetParameterValueByName(element=type, parameterName=string_10)
getParameterValueByName_11 = Element.GetParameterValueByName(element=type, parameterName=string_11)
getParameterValueByName_12 = Element.GetParameterValueByName(element=type, parameterName=string_12)
getParameterValueByName_13 = Element.GetParameterValueByName(element=all_elements_of_category, parameterName=string_13)
getParameterValueByName_14 = Element.GetParameterValueByName(element=all_elements_of_category, parameterName=string_14)
getParameterValueByName_15 = Element.GetParameterValueByName(element=all_elements_of_category, parameterName=string_15)
getParameterValueByName_16 = Element.GetParameterValueByName(element=type, parameterName=string_16)
getParameterValueByName_17 = Element.GetParameterValueByName(element=type, parameterName=string_17)
getParameterValueByName_18 = Element.GetParameterValueByName(element=all_elements_of_category, parameterName=string_18)
create_2 = List.Create(getParameterValueByName, getParameterValueByName_2, getParameterValueByName_3, getParameterValueByName_4, getParameterValueByName_5, getParameterValueByName_6, getParameterValueByName_7, getParameterValueByName_8, getParameterValueByName_9, getParameterValueByName_10, getParameterValueByName_11, getParameterValueByName_12, getParameterValueByName_13, getParameterValueByName_14, getParameterValueByName_15, getParameterValueByName_16, getParameterValueByName_17, getParameterValueByName_18)
transpose = List.Transpose(create_2)
addItemToFront = List.AddItemToFront(item=create, list=transpose)
writeToFile = CSV.WriteToFile(file_path, addItemToFront)
watch = Watch(all_elements_of_category)
fromPath = FileObject(file_path)  # "File.FromPath"
readFromFile = CSV.ReadFromFile(fromPath)
deconstruct = List.Deconstruct(list=readFromFile)
transpose_2 = List.Transpose(deconstruct.rest)
number = DoubleInput(0)
getItemAtIndex = List.GetItemAtIndex(list=transpose_2, index=number)
string_from_object = FromObject(getItemAtIndex)
setParameterByName = Element.SetParameterByName(element=all_elements_of_category, value=string_from_object)  # unwired: parameterName
number_2 = DoubleInput(1)
getItemAtIndex_2 = List.GetItemAtIndex(list=transpose_2, index=number_2)
string_from_object_2 = FromObject(getItemAtIndex_2)
setParameterByName_2 = Element.SetParameterByName(element=type, parameterName=string_2, value=string_from_object_2)
number_3 = DoubleInput(2)
getItemAtIndex_3 = List.GetItemAtIndex(list=transpose_2, index=number_3)
string_from_object_3 = FromObject(getItemAtIndex_3)
setParameterByName_3 = Element.SetParameterByName(element=type, parameterName=string_2, value=string_from_object_3)
number_4 = DoubleInput(3)
getItemAtIndex_4 = List.GetItemAtIndex(list=transpose_2, index=number_4)
setParameterByName_4 = Element.SetParameterByName(element=type, parameterName=string_4, value=getItemAtIndex_4)
number_5 = DoubleInput(4)
getItemAtIndex_5 = List.GetItemAtIndex(list=transpose_2, index=number_5)
setParameterByName_5 = Element.SetParameterByName(element=type, parameterName=string_5, value=getItemAtIndex_5)
number_6 = DoubleInput(5)
getItemAtIndex_6 = List.GetItemAtIndex(list=transpose_2, index=number_6)
string_from_object_4 = FromObject(getItemAtIndex_6)
setParameterByName_6 = Element.SetParameterByName(element=type, parameterName=string_6, value=string_from_object_4)
number_7 = DoubleInput(6)
getItemAtIndex_7 = List.GetItemAtIndex(list=transpose_2, index=number_7)
string_from_object_5 = FromObject(getItemAtIndex_7)
setParameterByName_7 = Element.SetParameterByName(element=type, parameterName=string_7, value=string_from_object_5)
number_8 = DoubleInput(7)
getItemAtIndex_8 = List.GetItemAtIndex(list=transpose_2, index=number_8)
string_from_object_6 = FromObject(getItemAtIndex_8)
setParameterByName_8 = Element.SetParameterByName(element=type, parameterName=string_8, value=string_from_object_6)
number_9 = DoubleInput(8)
getItemAtIndex_9 = List.GetItemAtIndex(list=transpose_2, index=number_9)
setParameterByName_9 = Element.SetParameterByName(element=type, parameterName=string_9, value=getItemAtIndex_9)
number_10 = DoubleInput(9)
getItemAtIndex_10 = List.GetItemAtIndex(list=transpose_2, index=number_10)
setParameterByName_10 = Element.SetParameterByName(element=type, parameterName=string_10, value=getItemAtIndex_10)
number_11 = DoubleInput(10)
getItemAtIndex_11 = List.GetItemAtIndex(list=transpose_2, index=number_11)
setParameterByName_11 = Element.SetParameterByName(element=type, parameterName=string_11, value=getItemAtIndex_11)
number_12 = DoubleInput(11)
getItemAtIndex_12 = List.GetItemAtIndex(list=transpose_2, index=number_12)
setParameterByName_12 = Element.SetParameterByName(element=type, parameterName=string_12, value=getItemAtIndex_12)
number_13 = DoubleInput(12)
getItemAtIndex_13 = List.GetItemAtIndex(list=transpose_2, index=number_13)
setParameterByName_13 = Element.SetParameterByName(element=all_elements_of_category, parameterName=string_13, value=getItemAtIndex_13)
number_14 = DoubleInput(13)
getItemAtIndex_14 = List.GetItemAtIndex(list=transpose_2, index=number_14)
setParameterByName_14 = Element.SetParameterByName(element=all_elements_of_category, parameterName=string_13, value=getItemAtIndex_14)
number_15 = DoubleInput(14)
getItemAtIndex_15 = List.GetItemAtIndex(list=transpose_2, index=number_15)
setParameterByName_15 = Element.SetParameterByName(element=all_elements_of_category, parameterName=string_13, value=getItemAtIndex_15)
number_16 = DoubleInput(15)
getItemAtIndex_16 = List.GetItemAtIndex(list=transpose_2, index=number_16)
setParameterByName_16 = Element.SetParameterByName(element=type, parameterName=string_12, value=getItemAtIndex_16)
number_17 = DoubleInput(16)
getItemAtIndex_17 = List.GetItemAtIndex(list=transpose_2, index=number_17)
setParameterByName_17 = Element.SetParameterByName(element=type, parameterName=string_12, value=getItemAtIndex_17)
number_18 = DoubleInput(17)
getItemAtIndex_18 = List.GetItemAtIndex(list=transpose_2, index=number_18)
setParameterByName_18 = Element.SetParameterByName(element=all_elements_of_category, parameterName=string_13, value=getItemAtIndex_18)
