# Dynamo graph Doors_Export.dyn (Dynamo 1.2.1.3083)

file_path = Filename(".\Doors.csv")
string = StringInput("Mark")
string_2 = StringInput("Type Mark")
string_3 = StringInput("Width")
string_4 = StringInput("Height")
string_5 = StringInput("Thickness")
string_6 = StringInput("DS_Door_Type_(SFT)")
string_7 = StringInput("DS_Door_Material_(SFT)")
string_8 = StringInput("DS_Door_Finish_(SPI)")
string_9 = StringInput("DS_Fire_Rating_(SFT)")
string_10 = StringInput("DS_Frame_Type_(SFT)")
string_11 = StringInput("DS_Frame_Material_(SFT)")
string_12 = StringInput("DS_Frame_Finish_(SPI)")
string_13 = StringInput("DS_Frame_Detail_Head_(SPI)")
string_14 = StringInput("DS_Frame_Detail_Jamb_(SPI)")
string_15 = StringInput("DS_Frame_Detail_Sill_(SPI)")
string_16 = StringInput("DS_Fire_Rating_(SFT)")
string_17 = StringInput("DS_Hardware_Set_(SFT)")
string_18 = StringInput("DS_Notes_(SPI)")
create = List.Create(string, string_2, string_3, string_4, string_5, string_6, string_7, string_8, string_9, string_10, string_11, string_12, string_13, string_14, string_15, string_16, string_17, string_18)
categories = Categories("Doors")
all_elements_of_category = ElementsOfCategory(categories)
getParameterValueByName = Element.GetParameterValueByName(element=all_elements_of_category, parameterName=string)
type = Archilab.Grimshaw.Elements.Element.Type(all_elements_of_category)
getParameterValueByName_2 = Element.GetParameterValueByName(element=type, parameterName=string_2)
getParameterValueByName_3 = Element.GetParameterValueByName(element=type, parameterName=string_3)
getParameterValueByName_4 = Element.GetParameterValueByName(element=type, parameterName=string_4)
getParameterValueByName_5 = Element.GetParameterValueByName(element=type, parameterName=string_5)
getParameterValueByName_6 = Element.GetParameterValueByName(element=type, parameterName=string_6)
getParameterValueByName_7 = Element.GetParameterValueByName(element=type, parameterName=string_7)
name = Material.Name(getParameterValueByName_7)
getParameterValueByName_8 = Element.GetParameterValueByName(element=type, parameterName=string_8)
name_2 = Material.Name(getParameterValueByName_8)
getParameterValueByName_9 = Element.GetParameterValueByName(element=type, parameterName=string_9)
getParameterValueByName_10 = Element.GetParameterValueByName(element=type, parameterName=string_10)
getParameterValueByName_11 = Element.GetParameterValueByName(element=type, parameterName=string_11)
name_3 = Material.Name(getParameterValueByName_11)
getParameterValueByName_12 = Element.GetParameterValueByName(element=type, parameterName=string_12)
name_4 = Material.Name(getParameterValueByName_12)
getParameterValueByName_13 = Element.GetParameterValueByName(element=all_elements_of_category, parameterName=string_13)
getParameterValueByName_14 = Element.GetParameterValueByName(element=all_elements_of_category, parameterName=string_14)
getParameterValueByName_15 = Element.GetParameterValueByName(element=all_elements_of_category, parameterName=string_15)
getParameterValueByName_16 = Element.GetParameterValueByName(element=type, parameterName=string_16)
getParameterValueByName_17 = Element.GetParameterValueByName(element=type, parameterName=string_17)
getParameterValueByName_18 = Element.GetParameterValueByName(element=all_elements_of_category, parameterName=string_18)
create_2 = List.Create(getParameterValueByName, getParameterValueByName_2, getParameterValueByName_3, getParameterValueByName_4, getParameterValueByName_5, getParameterValueByName_6, name, name_2, getParameterValueByName_9, getParameterValueByName_10, name_3, name_4, getParameterValueByName_13, getParameterValueByName_14, getParameterValueByName_15, getParameterValueByName_16, getParameterValueByName_17, getParameterValueByName_18)
transpose = List.Transpose(create_2)
addItemToFront = List.AddItemToFront(item=create, list=transpose)
writeToFile = CSV.WriteToFile(file_path, addItemToFront)
watch = Watch(all_elements_of_category)
