# Dynamo graph Doors_Import.dyn (Dynamo 1.2.1.3083)

categories = Categories("Doors")
all_elements_of_category = ElementsOfCategory(categories)
watch = Watch(all_elements_of_category)
string = StringInput("Mark")
file_path = Filename(".\Doors.csv")
fromPath = FileObject(file_path)  # "File.FromPath"
readFromFile = CSV.ReadFromFile(fromPath)
deconstruct = List.Deconstruct(list=readFromFile)
transpose = List.Transpose(deconstruct.rest)
number = DoubleInput(0)
getItemAtIndex = List.GetItemAtIndex(list=transpose, index=number)
string_from_object = FromObject(getItemAtIndex)
setParameterByName = Element.SetParameterByName(element=all_elements_of_category, parameterName=string, value=string_from_object)
type = Archilab.Grimshaw.Elements.Element.Type(all_elements_of_category)
string_2 = StringInput("Type Mark")
number_2 = DoubleInput(1)
getItemAtIndex_2 = List.GetItemAtIndex(list=transpose, index=number_2)
string_from_object_2 = FromObject(getItemAtIndex_2)
setParameterByName_2 = Element.SetParameterByName(element=type, parameterName=string_2, value=string_from_object_2)
string_3 = StringInput("Width")
number_3 = DoubleInput(2)
getItemAtIndex_3 = List.GetItemAtIndex(list=transpose, index=number_3)
setParameterByName_3 = Element.SetParameterByName(element=type, parameterName=string_3, value=getItemAtIndex_3)
string_4 = StringInput("Height")
number_4 = DoubleInput(3)
getItemAtIndex_4 = List.GetItemAtIndex(list=transpose, index=number_4)
setParameterByName_4 = Element.SetParameterByName(element=type, parameterName=string_4, value=getItemAtIndex_4)
string_5 = StringInput("Thickness")
number_5 = DoubleInput(4)
getItemAtIndex_5 = List.GetItemAtIndex(list=transpose, index=number_5)
setParameterByName_5 = Element.SetParameterByName(element=type, parameterName=string_5, value=getItemAtIndex_5)
string_6 = StringInput("DS_Door_Type_(SFT)")
number_6 = DoubleInput(5)
getItemAtIndex_6 = List.GetItemAtIndex(list=transpose, index=number_6)
string_from_object_3 = FromObject(getItemAtIndex_6)
setParameterByName_6 = Element.SetParameterByName(element=type, parameterName=string_6, value=string_from_object_3)
string_7 = StringInput("DS_Door_Material_(SFT)")
number_7 = DoubleInput(6)
getItemAtIndex_7 = List.GetItemAtIndex(list=transpose, index=number_7)
byName = Material.ByName(getItemAtIndex_7)
setParameterByName_7 = Element.SetParameterByName(element=type, parameterName=string_7, value=byName)
string_8 = StringInput("DS_Door_Finish_(SPI)")
number_8 = DoubleInput(7)
getItemAtIndex_8 = List.GetItemAtIndex(list=transpose, index=number_8)
byName_2 = Material.ByName(getItemAtIndex_8)
setParameterByName_8 = Element.SetParameterByName(element=type, parameterName=string_8, value=byName_2)
string_9 = StringInput("DS_Fire_Rating_(SFT)")
number_9 = DoubleInput(8)
getItemAtIndex_9 = List.GetItemAtIndex(list=transpose, index=number_9)
string_from_object_4 = FromObject(getItemAtIndex_9)
setParameterByName_9 = Element.SetParameterByName(element=type, parameterName=string_9, value=string_from_object_4)
string_10 = StringInput("DS_Frame_Type_(SFT)")
number_10 = DoubleInput(9)
getItemAtIndex_10 = List.GetItemAtIndex(list=transpose, index=number_10)
setParameterByName_10 = Element.SetParameterByName(element=type, parameterName=string_10, value=getItemAtIndex_10)
string_11 = StringInput("DS_Frame_Material_(SFT)")
number_11 = DoubleInput(10)
getItemAtIndex_11 = List.GetItemAtIndex(list=transpose, index=number_11)
byName_3 = Material.ByName(getItemAtIndex_11)
setParameterByName_11 = Element.SetParameterByName(element=type, parameterName=string_11, value=byName_3)
string_12 = StringInput("DS_Frame_Finish_(SPI)")
number_12 = DoubleInput(11)
getItemAtIndex_12 = List.GetItemAtIndex(list=transpose, index=number_12)
byName_4 = Material.ByName(getItemAtIndex_12)
setParameterByName_12 = Element.SetParameterByName(element=type, parameterName=string_12, value=byName_4)
string_13 = StringInput("DS_Frame_Detail_Head_(SPI)")
number_13 = DoubleInput(12)
getItemAtIndex_13 = List.GetItemAtIndex(list=transpose, index=number_13)
string_from_object_5 = FromObject(getItemAtIndex_13)
setParameterByName_13 = Element.SetParameterByName(element=all_elements_of_category, parameterName=string_13, value=string_from_object_5)
string_14 = StringInput("DS_Frame_Detail_Jamb_(SPI)")
number_14 = DoubleInput(13)
getItemAtIndex_14 = List.GetItemAtIndex(list=transpose, index=number_14)
string_from_object_6 = FromObject(getItemAtIndex_14)
setParameterByName_14 = Element.SetParameterByName(element=all_elements_of_category, parameterName=string_14, value=string_from_object_6)
string_15 = StringInput("DS_Frame_Detail_Sill_(SPI)")
number_15 = DoubleInput(14)
getItemAtIndex_15 = List.GetItemAtIndex(list=transpose, index=number_15)
string_from_object_7 = FromObject(getItemAtIndex_15)
setParameterByName_15 = Element.SetParameterByName(element=all_elements_of_category, parameterName=string_15, value=string_from_object_7)
string_16 = StringInput("DS_Fire_Rating_(SFT)")
number_16 = DoubleInput(15)
getItemAtIndex_16 = List.GetItemAtIndex(list=transpose, index=number_16)
string_from_object_8 = FromObject(getItemAtIndex_16)
setParameterByName_16 = Element.SetParameterByName(element=type, parameterName=string_16, value=string_from_object_8)
string_17 = StringInput("DS_Hardware_Set_(SFT)")
number_17 = DoubleInput(16)
getItemAtIndex_17 = List.GetItemAtIndex(list=transpose, index=number_17)
string_from_object_9 = FromObject(getItemAtIndex_17)
setParameterByName_17 = Element.SetParameterByName(element=type, parameterName=string_17, value=string_from_object_9)
string_18 = StringInput("DS_Notes_(SPI)")
number_18 = DoubleInput(17)
getItemAtIndex_18 = List.GetItemAtIndex(list=transpose, index=number_18)
setParameterByName_18 = Element.SetParameterByName(element=all_elements_of_category, parameterName=string_18, value=getItemAtIndex_18)
