# Dynamo graph Duplicate Sheets and Views.dyn (Dynamo 1.3.2.2480)

code_block = CodeBlock {  }
categories = Categories("Sheets")
all_elements_of_category = ElementsOfCategory(categories)
watch = Watch(all_elements_of_category)
boolean = BoolSelector(true)
boolean_2 = BoolSelector(true)
code_block_2 = CodeBlock { 1; }
code_block_3 = CodeBlock { "P1-"; }
duplicate = Revit.Sheet.Duplicate(watch, boolean, boolean_2, code_block_2, arg5=code_block_3)
