# Dynamo graph Find Import Symbols in a MIP Family.dyn (Dynamo 2.3.0.5885)
# packages: Clockwork for Dynamo 2.x 2.1.2

select_model_elements = DSModelElementsSelection()  # 2 picked in the model
geometry = Element.Geometry(element=select_model_elements)
type = Object.Type(obj=geometry)
string = StringInput("Mesh")
contains = String.Contains(str=type@L2, searchFor=string)
boolean = BoolSelector(true)
contains_2 = List.Contains(list=contains@L2, item=boolean)
filterByBoolMask = List.FilterByBoolMask(list=select_model_elements, mask=contains_2)
watch = Watch(filterByBoolMask.in)
watch_2 = Watch(type)
watch_3 = Watch(contains)
watch_4 = Watch(contains_2)
watch_5 = Watch(select_model_elements)
level = Custom[Element.Level](element=select_model_elements)  # package Clockwork for Dynamo 2.x; Gets an element's level
watch_6 = Watch(level)
material = Custom[Category.Material]()  # package Clockwork for Dynamo 2.x; Retrieves the material assigned to the given category in the object styles; unwired: category
materials = Custom[Element.Materials+]()  # package Clockwork for Dynamo 2.x; Retrieves all materials from a given element. Unlike the OOTB node Element.GetMaterials, it also retrieves QTO information.; unwired: element
level_2 = Custom[Element.Level](element=select_model_elements)
watch_7 = Watch(level_2)
associatedFamilyParameters = Custom[Element.AssociatedFamilyParameters]()  # package Clockwork for Dynamo 2.x; Returns the associated family parameters of an element in a family (and the respective element parameters). PLEASE NOTE: This node will only work in a family document!; unwired: element
levels = Levels()  # nothing selected
watch_8 = Watch(geometry)
