# Dynamo graph Find meshes inside in-place-families.dyn (Dynamo 2.0.2.6826)

categories = Categories(index=230)
getCategory = Element.GetCategory()  # unwired: element
select_model_element = DSModelElementSelection()  # 1 picked in the model
element_types = ElementTypes(index=119)
all_elements_of_type = ElementsOfType(element_type=element_types)
watch = Watch(all_elements_of_type)
