# Dynamo graph Finish Key_Read.dyn (Dynamo 1.2.1.3083)

file_path = Filename(".\Finish_Key_Read.csv")

# group: old
fromPath = FileObject(file_path)  # "File.FromPath"
readFromFile = CSV.ReadFromFile(fromPath)

views = Views("FINISH SCHEDULE KEYNOTES")
byFilePath = Archilab.Grimshaw.CsvParsers.Csv.ByFilePath(file_path)
code_block = CodeBlock { 0; }
valuesByRowNumber = Archilab.Grimshaw.CsvParsers.Csv.ValuesByRowNumber(byFilePath, code_block)
code_block_2 = CodeBlock { {"FS_Key_Code","FS_Key_Description","FS_Key_Manufacturer","FS_Key_Dimensions","FS_Key_Thickness","FS_Key_Product_Style","FS_Key_Color_Finish","FS_Key_Substrate","FS_Key_Notes_Location","FS_Key_Unit_Cost","FS_Key_Contact"}; }
key_schedule = Custom[Key Schedule](ViewSchedule=views, Data=valuesByRowNumber, Parameter_Names=code_block_2)  # This node will take a key schedule, data and a list of parameters and populate it with infomation from data parameter. Visit www.archi-lab.net for more information on how to prep this node for take off.
