# Dynamo graph Finish Key_Write.dyn (Dynamo 1.2.1.3083)

file_path = Filename(".\Finish_Key_Write.csv")
views = Views("FINISH SCHEDULE KEYNOTES")
getScheduleData = Custom[bimorph.GetScheduleData](scheduleViewOrName=views)  # Gets all the table data from a given schedule as strings
writeToFile = CSV.WriteToFile(file_path, getScheduleData)
fromPath = FileObject(file_path)  # "File.FromPath"
watch = Watch(views)
