# Dynamo graph DynamoToFlux.dyn (Dynamo 0.9.0.3067)

# group: Flux Workflow to select the Flux Project and Data Key that you would like to work with. Learn more on our resources pages! flux.io/r/
flux_projects = FluxProjects()
select_project = FluxSelector(flux_projects)  # 1 picked in the model
data_keys = FluxProjectKeys(select_project)
select_key = FluxSelector(data_keys)  # 1 picked in the model
flow_control = FluxModeSwitcher()  # 1 picked in the model

# group: Connect the "Cuboid" output to the "Value" input to send data to Flux
byCorners = Cuboid.ByCorners()
to_flux = ToFlux(select_key, flow_control, byCorners)

categories = Categories("Lines")
all_elements_of_category = ElementsOfCategory(categories)
watch = Watch(all_elements_of_category)
