# Dynamo graph IFC Testing.dyn (Dynamo 2.3.0.5885)

code_block = CodeBlock { 3; }
code_block_2 = CodeBlock { 1; }
code_block_3 = CodeBlock { 3; }
byCoordinates = Point.ByCoordinates(x=code_block, y=code_block_2, z=code_block_3)
code_block_4 = CodeBlock { 1; }
code_block_5 = CodeBlock { 3; }
code_block_6 = CodeBlock { 2; }
byWidthLength = Rectangle.ByWidthLength(width=code_block_6, length=code_block_6)
extrudeAsSolid = Curve.ExtrudeAsSolid(curve=byWidthLength, direction=code_block_6)
extrudeAsSolid_2 = Curve.ExtrudeAsSolid(curve=byWidthLength)
