# Dynamo graph Key Schedule - Read CSV.dyn (Dynamo 1.3.0.875)

# group: INPUT:
schedule_view = Views("DRAWING INDEX")
csv_file_path = Filename("..\..\..\..\Lake Geneva - Vacation Rental\Open - Lake Geneva - Vacation Rental\Models\Text and Spreadsheets\Sheet List.csv")
replace_newline = BoolSelector(false)
replacement = StringInput(", ")
refresh = BoolSelector(false)

# note: filePath: string
# repNewLine: bool
# replacement: str
# Refresh: bool
readUnicode = Python(IN[0]=csv_file_path, IN[1]=replace_newline, IN[2]=replacement, IN[3]=refresh)  # "csv.ReadUnicode"
# ---------- readUnicode.python (17 lines) ----------
# Copyright(c) 2016, Bad Monkeys
# www.badmonkeys.net

import clr
import System
from System.IO import *

pf_path = System.Environment.GetFolderPath(System.Environment.SpecialFolder.ProgramFilesX86)
import sys
sys.path.append('%s\IronPython 2.7\Lib' %pf_path)
import csv

csv_path, to_replace, rep, _ = IN

with open(csv_path, 'rU') as f:
	data = csv.reader(f)
	OUT = [ [cell.replace('\n', rep) for cell in row] for row in data] if to_replace else list(data)
# ----------------------------------------
# note: scheduleView: view
# headers: string[]
# data: string[][]
# refresh: bool
deconstruct = List.Deconstruct(list=readUnicode)
populate = Python(IN[0]=schedule_view, IN[1]=deconstruct.first, IN[2]=deconstruct.rest, IN[3]=refresh)  # "KeySchedule.Populate"
# ---------- populate.python (60 lines) ----------
# Copyright(c) 2017, Dimitar Venkov
# @5devene, dimitar.ven@gmail.com
# www.badmonkeys.net
# inspired by the Key Schedule node from arcni-lab.net

import clr

clr.AddReference('RevitAPI')
from Autodesk.Revit.DB import *

clr.AddReference('RevitServices')
from RevitServices.Persistence import DocumentManager
from RevitServices.Transactions import TransactionManager
doc = DocumentManager.Instance.CurrentDBDocument

ks1 = UnwrapElement(IN[0])
headers = IN[1]
data = IN[2]

try:
	TransactionManager.Instance.EnsureInTransaction(doc)
	if any(isinstance(item, list) for item in data):
		col_count = max(map(len, data) )
		if col_count != ks1.Definition.GetFieldCount() or col_count != len(headers):
			raise Exception('Prepare the key schedule fields in\nadvance, so that they match the data set.')
		else:
			tableData = ks1.GetTableData()
			sectionData = tableData.GetSectionData(SectionType.Body)
			row_count = sectionData.NumberOfRows
			firstRows = 1
			if row_count != 1:
				st1 = SubTransaction(doc)
				st1.Start()
				try:
					sectionData.RemoveRow(1)
				except:
					firstRows = 2
				st1.RollBack()
				st1.Dispose()
			if row_count - firstRows < len(data):
				rowsToAdd = len(data) - row_count + firstRows
				for _ in xrange(0, rowsToAdd):
					sectionData.InsertRow(0)
			else:
				# schedule when updating might already have too many rows 
				rowsToDelete = row_count - firstRows - len(data)
				for i in xrange(row_count -1, row_count - rowsToDelete -1, -1):
					sectionData.RemoveRow(i)
			doc.Regenerate()
			row_elems = FilteredElementCollector(doc, ks1.Id)
			i = 0
			for e in row_elems:
				params = e.ParametersMap
				for j in xrange(col_count):
					params[headers[j] ].Set(str(data[i][j]) )
				i += 1
	TransactionManager.Instance.TransactionTaskDone()
	OUT = "Schedule set successfully."
except Exception, ex:
	OUT = ex
# ----------------------------------------
watch = Watch(populate)
code_block = CodeBlock()
# ---------- code_block.designscript (27 lines) ----------
/*

DYNAMO VERSION: 1.1+
REVIT VERSION: 2015+

Created by: Dimitar Venkov
Created on: 09/01/17

Modified by:
Modified on:

REQUIRED PACKAGES:
------------------------------

DESCRIPTION:
------------------------------
- Make sure that you've created a Schedule beforehand
  and have added a new Text field (Fields > Add Parameter,
  Type of Parameter > Text) for each header name in the
  csv file.
- As of the graph creation date, key schedule fields can
  not be created and added programatically through the API.

ISSUES:
------------------------------

*/;
# ----------------------------------------
