# Dynamo graph TagMaterials.dyn (Dynamo 2.3.0.5885)
# packages: Clockwork for Dynamo 2.x 2.1.2

# group: INPUT:
code_block = CodeBlock { Category.ByName("Generic Models"); }
# note: In our particular case all elements are
# modeled as Generic Models
# note: This is the depth at which  elements
# will be tagged.  Try to keep it to a realistic
# view depth. Can act as a Refresh switch too.
view_depth_cut_off_distance_feet = DoubleSlider(12.901, range=0.001..15 step 0.1)  # graph input
# note: After running the graphfor the first time, Dynamo can't guess when you've made any changes inside Revit. Toggle the "Refresh" bool once to notify Dynamo of any changes. This may include but is not limited to:
#    - changing the active view
#    - editing the view crop box
#    - editing the view scale
refresh_the_view = BoolSelector(false)  # graph input
add_an_elbow = BoolSelector(true)  # graph input

# note: This slider controls the final position
# of the tags:
# 0 - automatic mode
# 1 - place all tags LEFT
# 2 - place all tags RIGHT
tag_placement_mode = IntegerSlider(2, range=0..2 step 1)  # graph input

# group: Verify
right_material_tag_type = FamilyTypes("OD_Material Tag:RIGHT")  # graph input
left_material_tag_type = FamilyTypes("OD_Material Tag:LEFT")  # graph input

# group: Part 1 : Tag Creation
code_block_2 = CodeBlock { shouldRun = 0; }
tag_creation_script = Python(IN[0]=code_block, IN[1]=view_depth_cut_off_distance_feet, IN[2]=tag_placement_mode, IN[3]=refresh_the_view, IN[4]=right_material_tag_type, IN[5]=left_material_tag_type)
# ---------- tag_creation_script.python (179 lines) ----------
import clr
from math import floor

clr.AddReference("RevitServices")
from RevitServices.Persistence import DocumentManager
from RevitServices.Transactions import TransactionManager
doc = DocumentManager.Instance.CurrentDBDocument
uidoc = DocumentManager.Instance.CurrentUIApplication.ActiveUIDocument
app = DocumentManager.Instance.CurrentUIApplication.Application
uiapp = DocumentManager.Instance.CurrentUIApplication

clr.AddReference("RevitAPI")
import  Autodesk.Revit.DB as DB

clr.AddReference("RevitNodes")
import Revit
clr.ImportExtensions(Revit.Elements)
clr.ImportExtensions(Revit.GeometryConversion)

clr.AddReference('ProtoGeometry')
import Autodesk.DesignScript.Geometry as DS

clr.AddReference("System")
import System
from System.Collections.Generic import List
PF_path = System.Environment.GetFolderPath(System.Environment.SpecialFolder.ProgramFilesX86)
Lib_path = '\IronPython 2.7\Lib'
import sys
sys.path.append("%s%s" % (PF_path, Lib_path))
import ctypes

def getFirstSolid(geo):
	for g in geo:
		if isinstance(g, DB.GeometryInstance):
			return getFirstSolid(g.GetInstanceGeometry())
		else:
			v = getattr(g, "Volume", 0)
			if v != 0:
				return g

def getSolidBoundPts(s):
	x, y, z = [], [], []
	for e in s.Edges:
		p = e.Evaluate(0)
		x.append(p.X)
		y.append(p.Y)
		z.append(p.Z)
	
	return DB.XYZ(min(x), min(y), min(z)), DB.XYZ(max(x), max(y), max(z))

SetForegroundWindow = ctypes.windll.user32.SetForegroundWindow
SendKeys = ctypes.windll.user32.keybd_event

def UP1():
	SendKeys(0x26, 0, 0, 0)
	SendKeys(0x26, 0, 0x0002, 0)
def DN1():
	SendKeys(0x28, 0, 0, 0)
	SendKeys(0x28, 0, 0x0002, 0)

# INPUT
Cat1, cutoff_depth, TAG_PLACEMENT_MODE, _, IfcTag, IfcTagLeft = UnwrapElement(IN)
IfcTagId, IfcTagLeftId = IfcTag.Id, IfcTagLeft.Id

# get active view's data
view = doc.ActiveView
def pullOntoViewPlane(pt, n=view.ViewDirection, o=view.Origin):
	d = n.DotProduct(o) - n.DotProduct(pt)
	return pt + n * d

# temporarily modify the view's clip depth to get the visible elements
TransactionManager.Instance.EnsureInTransaction(doc)

cropMan = view.GetCropRegionShapeManager()
if cropMan.Split:
	with DB.SubTransaction(doc) as subT:
		subT.Start()
		min0, max0 = cropMan.GetSplitRegionMinimum(0), cropMan.GetSplitRegionMaximum(0)
		min1, max1 = cropMan.GetSplitRegionMinimum(1), cropMan.GetSplitRegionMaximum(1)
		cropMan.RemoveSplit()
		crop1 = cropMan.GetCropShape()
		subT.RollBack()
else:
	crop1 = cropMan.GetCropShape()

fec1 = DB.FilteredElementCollector(doc, view.Id).OfCategoryId(Cat1.Id)
VisibleEl = [e for e in fec1]

# get the crop region and shrink appropriately to the tagscale
cropSolid = DB.GeometryCreationUtilities.CreateExtrusionGeometry(crop1, view.ViewDirection, cutoff_depth)

cropCenter = crop1[0].GetPlane().Origin
viewRight = view.RightDirection
cropHalfWidth = abs(view.CropBox.Max.X - view.CropBox.Min.X) / 2 + 0.4 # a bit of a buffer
cropCenter_dot = viewRight.DotProduct(cropCenter)

# collect all existing tags in the view and find their host elements
ViewTags = DB.FilteredElementCollector(doc, view.Id).OfClass(DB.IndependentTag)
TaggedElId = set(t.TaggedLocalElementId.IntegerValue for t in ViewTags)

geoOpt = DB.Options()
intOptions = DB.SolidCurveIntersectionOptions()
intOptions.ResultType = DB.SolidCurveIntersectionMode.CurveSegmentsInside

# find a point inside each element. Elements that are already
# tagged or that are beyond the crop's depth will be ignored
toTag = []
avrgPt, avrgCount = DB.XYZ.Zero, 0
for e in VisibleEl:
	if e.Id.IntegerValue in TaggedElId:
		continue
	
	elSolid = getFirstSolid(e.Geometry[geoOpt])
	intersectedSolid = DB.BooleanOperationsUtils.ExecuteBooleanOperation(
		cropSolid, elSolid, DB.BooleanOperationsType.Intersect)
	if intersectedSolid.Volume == 0:
		continue
	a, b = getSolidBoundPts(intersectedSolid)
	a, b = pullOntoViewPlane(a), pullOntoViewPlane(b)
	l = DB.Line.CreateBound(a, b)
	xResult = intersectedSolid.IntersectWithCurve(l, intOptions)
	l.Dispose()
	
	curves = [c for c in xResult]
	curves.sort(key=lambda c: c.Length)
	tagPt = curves[-1].Evaluate(0.5, 1)
	toTag.append((e, tagPt))
	avrgPt += tagPt
	avrgCount += 1

# place the actual tags and compute the final tag position
tm1 = DB.TagMode.TM_ADDBY_MATERIAL
to1 = DB.TagOrientation.Horizontal
tags, areRight = [], []
if avrgCount:
	avrgPt /= avrgCount
	avrgPt_dot = viewRight.DotProduct(avrgPt)
	for elem, tagPt in toTag:
		tagPt_dot = viewRight.DotProduct(tagPt)
		distToCenter = cropCenter_dot - tagPt_dot
		distToAvrg = avrgPt_dot - tagPt_dot
		rightOfCenter = distToCenter < 0
		
		if TAG_PLACEMENT_MODE == 0:
			shiftRight = distToAvrg < 0
		elif TAG_PLACEMENT_MODE == 1:
			shiftRight = False
		else:
			shiftRight = True
		
		mul = distToCenter + cropHalfWidth if shiftRight else distToCenter - cropHalfWidth
		headPt = tagPt + mul * viewRight
		
		tag = DB.IndependentTag.Create(doc, view.Id, DB.Reference(e), 1, tm1, to1, tagPt)
		typeId = IfcTagId if shiftRight else IfcTagLeftId
		tag.ChangeTypeId(typeId)
		tag.LeaderEnd = tagPt
		tag.TagHeadPosition = headPt
		tags.append(tag)
		areRight.append(shiftRight)

TransactionManager.Instance.TransactionTaskDone()

geoOpt.Dispose()
intOptions.Dispose()

tagsId = List[DB.ElementId](t.Id for t in tags)
uidoc.Selection.SetElementIds(tagsId)

if "2019" in app.VersionNumber:
	rvt_winH = uiapp.MainWindowHandle
else:
	rvt_proc = System.Diagnostics.Process.GetProcessesByName("Revit")
	rvt_winH = rvt_proc[0].MainWindowHandle
active_win = SetForegroundWindow(rvt_winH)
UP1()
DN1()

OUT = [t.Id.IntegerValue for t in tags], areRight, [c.ToProtoType(1) for c in crop1[0]]
# ----------------------------------------
code_block_3 = CodeBlock(r=tag_creation_script) { tags = r[0]; isRight = r[1]; }
filterByBoolMask = List.FilterByBoolMask(list=code_block_3.tags, mask=code_block_3.isRight)
create = List.Create(item0=code_block_2, item1=filterByBoolMask.in, item2=filterByBoolMask.out)

# group: Part 2 : Tag Distribution
getATempPath = Python()  # graph input
# ---------- getATempPath.python (3 lines) ----------
import System

OUT = System.IO.Path.GetTempFileName().Replace(".tmp", ".csv")
# ----------------------------------------
fromPath = FileObject(path=getATempPath)  # "File.FromPath"
exportCSV = Data.ExportCSV(filePath=getATempPath, data=create)
passthrough = Custom[Passthrough](passThrough=fromPath, waitFor=exportCSV)  # package Clockwork for Dynamo 2.x; Forces a sequential order of execution. The node wired into the output of the Passthrough node will be executed *after* the node wired into the waitFor input (e.g. important for some Revit operations). The value of the passThrough input will be passed on to the node wired into the output port of the Passthrough node.
tag_distribution_script = Python(IN[0]=passthrough, IN[1]=add_an_elbow)
# ---------- tag_distribution_script.python (72 lines) ----------
import clr

clr.AddReference("RevitServices")
from RevitServices.Persistence import DocumentManager
from RevitServices.Transactions import TransactionManager
doc = DocumentManager.Instance.CurrentDBDocument

import System
import sys
pf_path = System.Environment.GetFolderPath(System.Environment.SpecialFolder.ProgramFilesX86)
sys.path.append('%s\IronPython 2.7\Lib' % pf_path)
import csv

clr.AddReference('RevitAPI')
import Autodesk.Revit.DB as DB

clr.AddReference('RevitNodes')
import Revit
clr.ImportExtensions(Revit.Elements)

def tagHeight(bb):
	min = bb.Min
	max = bb.Max
	return abs(max.Z - min.Z)

view = doc.ActiveView
def distributeTags(tags, elbowVector=None):
	tags = sorted(tags, key=lambda t: t.LeaderEnd.Z)
	tagHeights = map(tagHeight, [t.get_BoundingBox(view) for t in tags])
	half = sum(tagHeights) / 2
	
	z1 = tags[0].TagHeadPosition.Z
	for i in xrange(len(tags)):
		oldPt = tags[i].TagHeadPosition
		if oldPt.Z < z1:
			newPt = DB.XYZ(oldPt.X, oldPt.Y, z1)
			tags[i].TagHeadPosition = newPt
		elif oldPt.Z >= z1:
			z1 = oldPt.Z
			newPt = oldPt
		if i + 1 < len(tags): z1 += (tagHeights[i]*0.6 + tagHeights[i+1]*0.6)
		
		if elbowVector is not None:
			tags[i].LeaderElbow = newPt + elbowVector
	return
	
path = str(IN[0])
addElbow = IN[1]

with open(path, "r") as f:
	shouldRun, rightId, leftId = f.readlines()

shouldRun = int(shouldRun)
if shouldRun:
	rightTags = [doc.GetElement(DB.ElementId(int(i))) for i in rightId.split(",") if i.strip()]
	leftTags =[doc.GetElement(DB.ElementId(int(i))) for i in leftId.split(",") if i.strip()]
	TransactionManager.Instance.EnsureInTransaction(doc)
	if rightTags:
		elbowVector = view.RightDirection.Negate() * 0.4 if addElbow else None
		distributeTags(rightTags, elbowVector)
	if leftTags:
		elbowVector = view.RightDirection * 0.4 if addElbow else None
		distributeTags(leftTags, elbowVector)
	
	TransactionManager.Instance.TransactionTaskDone()
	OUT = [t.ToDSType(1) for t in rightTags], [t.ToDSType(1) for t in leftTags]
else:
	with open(path, 'w') as f:
		f.write("1\n")
		f.write(rightId)
		f.write(leftId)
	OUT = "Run again", ""
# ----------------------------------------
code_block_4 = CodeBlock(r=tag_distribution_script) { right = r[0]; left = r[1]; }

# group: Report
right_tags = Watch(code_block_4.right)
left_tags = Watch(code_block_4.left)

code_block_5 = CodeBlock()
# ---------- code_block_5.designscript (29 lines) ----------
/*

DYNAMO VERSION: 1.3x

Created by: Dimitar Venkov
Created on: 14/01/2019

Modified by:
Modified on:

REQUIRED PACKAGES:
------------------------------
- Clockwork 1.32.0

DESCRIPTION:
------------------------------
- This graph will material tag all Gemeric Model
  Model-In-Place families. The execution is broken
  up into two parts - a tag creation part and a
  tag distribution part. That means you have to
  run the graph *TWICE* consecutively.

ISSUES AND LIMITATIONS:
------------------------------
- If working in Revit 2018 or earlier, make sure
  that you have only one instance of Revit open
  during execution.

*/;
# ----------------------------------------
