# Dynamo graph PolyCurve by Profile Type.dyn (Dynamo 1.2.1.3083)

bySweep = PolySurface.BySweep()  # unwired: arg0, arg1
family_types = FamilyTypes("Fascia-Flat:1x8")
polycurve_by_profile_family_type = Custom[PolyCurve by Profile Family Type](Family_Type=family_types)  # It takes an input of a profile family type and extract curves from it converting them to polycurves and curve segments for use in Dynamo (sweeps).
watch = Watch(polycurve_by_profile_family_type.Poly_Curve_s)
watch_2 = Watch(polycurve_by_profile_family_type.Curve_Segments)
ZAxis = Vector.ZAxis()
code_block = CodeBlock { 1000; }
extrude = Curve.Extrude(curve=polycurve_by_profile_family_type.Poly_Curve_s, direction=ZAxis, distance=code_block)
