# Dynamo graph SOMD.dyn (Dynamo 1.2.1.3083)

family_types = FamilyTypes("LCL MD Form_Composite:LCL_2 1/2\" Slab on 3\" MD")
python_script = Python(IN[0]=family_types)
# ---------- python_script.python (41 lines) ----------
import clr
clr.AddReference('ProtoGeometry')
from Autodesk.DesignScript.Geometry import *

# Import ToDSType(bool) extension method
clr.AddReference("RevitNodes")
import Revit
clr.ImportExtensions(Revit.Elements)

# Import DocumentManager and TransactionManager
clr.AddReference("RevitServices")
import RevitServices
from RevitServices.Persistence import DocumentManager
from RevitServices.Transactions import TransactionManager

from System.Collections.Generic import *

# Import RevitAPI
clr.AddReference("RevitAPI")
import Autodesk
from Autodesk.Revit.DB import *

doc = DocumentManager.Instance.CurrentDBDocument
uiapp = DocumentManager.Instance.CurrentUIApplication
app = uiapp.Application

type = UnwrapElement(IN[0].Family.Name)
name = UnwrapElement(IN[0].Name)

family = UnwrapElement(IN[0]).Family

TransactionManager.Instance.ForceCloseTransaction()
famDoc = doc.EditFamily(family)

famCollector = FilteredElementCollector(famDoc)
sketch = famCollector.OfClass(Sketch)

for i in sketch:
	cArray = list(i.Profile)
cArray[:] = [[Revit.GeometryConversion.RevitToProtoCurve.ToProtoType(y, True ) for y in x] for x in cArray]
OUT = cArray
# ----------------------------------------
flatten = Flatten(python_script)
watch = Watch(flatten)
code_block = CodeBlock { {0,1,2,3}; }
getItemAtIndex = List.GetItemAtIndex(list=flatten, index=code_block)
byJoinedCurves = PolyCurve.ByJoinedCurves(getItemAtIndex)
endPoint = Curve.EndPoint(getItemAtIndex)
byPerimeterPoints = Surface.ByPerimeterPoints(endPoint)
area = Surface.Area(byPerimeterPoints)
lastItem = List.LastItem(flatten)
endPoint_2 = Curve.EndPoint(lastItem)
X = ReferencePoint.X(endPoint_2)
firstItem = List.FirstItem(flatten)
endPoint_3 = Curve.EndPoint(firstItem)
X_2 = ReferencePoint.X(endPoint_3)
sub = X - X_2
