# Dynamo graph Read CSV.dyn (Dynamo 2.2.1.5175)

# group: INPUT:
schedule_view = Views("SHEET INDEX")  # graph input
csv_file_path = Filename("..\..\..\..\OPENING DESIGN\CTR\Models & CAD\Current Spreadsheets\SHEET INDEX.csv")  # graph input
replace_newline = BoolSelector(true)  # graph input
replacement = StringInput(", ")  # graph input
refresh = BoolSelector(false)  # graph input

# note: filePath: string
# repNewLine: bool
# replacement: str
# Refresh: bool
readUnicode = Python(IN[0]=csv_file_path, IN[1]=replace_newline, IN[2]=replacement, IN[3]=refresh)  # "csv.ReadUnicode"
# ---------- readUnicode.python (19 lines) ----------
# Copyright(c) 2016, Bad Monkeys
# www.badmonkeys.net

import clr
import System
pf_path = System.Environment.GetFolderPath(System.Environment.SpecialFolder.ProgramFilesX86)
import sys
sys.path.append('%s\IronPython 2.7\Lib' %pf_path)
import csv

def iterStream(csv_path):
	with System.IO.File.OpenText(csv_path) as f:
		while not f.EndOfStream:
			yield f.ReadLine()
		return

csv_path, to_replace, rep, _ = IN
data = csv.reader((iterStream(csv_path)))
OUT = [[c.replace('\n', rep) for c in row] for row in data] if to_replace else list(data)
# ----------------------------------------
deconstruct = List.Deconstruct(list=readUnicode)
# note: scheduleView: view
# headers: string[]
# data: string[][]
# refresh: bool
populate = Python(IN[0]=schedule_view, IN[1]=deconstruct.first, IN[2]=deconstruct.rest, IN[3]=refresh)  # "KeySchedule.Populate"
# ---------- populate.python (60 lines) ----------
# Copyright(c) 2017, Dimitar Venkov
# @5devene, dimitar.ven@gmail.com
# www.badmonkeys.net
# inspired by the Key Schedule node from arcni-lab.net

import clr

clr.AddReference('RevitAPI')
from Autodesk.Revit.DB import *

clr.AddReference('RevitServices')
from RevitServices.Persistence import DocumentManager
from RevitServices.Transactions import TransactionManager
doc = DocumentManager.Instance.CurrentDBDocument

ks1 = UnwrapElement(IN[0])
headers = IN[1]
data = IN[2]

try:
	TransactionManager.Instance.EnsureInTransaction(doc)
	if any(isinstance(item, list) for item in data):
		col_count = max(map(len, data) )
		if col_count != ks1.Definition.GetFieldCount() or col_count != len(headers):
			raise Exception('Prepare the key schedule fields in\nadvance, so that they match the data set.')
		else:
			tableData = ks1.GetTableData()
			sectionData = tableData.GetSectionData(SectionType.Body)
			row_count = sectionData.NumberOfRows
			firstRows = 1
			if row_count != 1:
				st1 = SubTransaction(doc)
				st1.Start()
				try:
					sectionData.RemoveRow(1)
				except:
					firstRows = 2
				st1.RollBack()
				st1.Dispose()
			if row_count - firstRows < len(data):
				rowsToAdd = len(data) - row_count + firstRows
				for _ in xrange(0, rowsToAdd):
					sectionData.InsertRow(0)
			else:
				# schedule when updating might already have too many rows 
				rowsToDelete = row_count - firstRows - len(data)
				for i in xrange(row_count -1, row_count - rowsToDelete -1, -1):
					sectionData.RemoveRow(i)
			doc.Regenerate()
			row_elems = FilteredElementCollector(doc, ks1.Id)
			i = 0
			for e in row_elems:
				params = e.ParametersMap
				for j in xrange(col_count):
					params[headers[j] ].Set(unicode(data[i][j]) )
				i += 1
	TransactionManager.Instance.TransactionTaskDone()
	OUT = "Schedule set successfully."
except Exception, ex:
	OUT = ex
# ----------------------------------------
watch = Watch(populate)
code_block = CodeBlock()
# ---------- code_block.designscript (36 lines) ----------
/*

DYNAMO VERSION: 1.3+
REVIT VERSION: 2016+

Created by: Dimitar Venkov
Created on: 09/01/17

Modified by: Dimitar Venkov
Modified on: 12/03/18

Modified by:
Modified on:

REQUIRED PACKAGES:
------------------------------

DESCRIPTION:
------------------------------
- All files must be encoded as UTF-8.

- Make sure that you've created a Schedule beforehand
  and have added a new Text field (Fields > Add Parameter,
  Type of Parameter > Text) for each header name in the
  csv file.

- As of the graph creation date, key schedule fields can
  not be created and added programatically through the API.

- Before 'Run' the command make sure that the CSV file
  closed.

ISSUES:
------------------------------

*/;
# ----------------------------------------
