# Dynamo graph Revision to Sheets.dyn (Dynamo 1.2.0.2831)

boolean = BoolSelector(true)
get_all_revisions = Custom[Get All Revisions](RunIt=boolean)  # This node will return all Revisions currently defined in the mode.
revision_properties = Custom[Revision Properties](Revision=get_all_revisions)  # This node will return some most common Revision properties like Description or Issue Date.
revisions = Watch(revision_properties.Description)
# note: Select a Sheet Set to add Revisions
view_sets = ViewSetUI("Issue Set")
get_views_from_view_set = Custom[Get Views from View Set](ViewSet=view_sets)  # This node will take a name of a view set and return views/sheet elements contained in it.
code_block = CodeBlock { "SHEET_SCHEDULED"; }
get_built_in_parameter = Custom[Get Built In Parameter](ParameterNames=code_block, Elements=get_views_from_view_set)  # This node will take an input of a built in parameter name and element to return that parameters value.
formula = Formula("x==1", x=get_built_in_parameter)
boolean_2 = BoolSelector(true)
boolean_3 = BoolSelector(false)
if_ = If(test=formula, true=boolean_2, false=boolean_3)
filterByBoolMask = List.FilterByBoolMask(list=get_views_from_view_set, mask=if_)
code_block_2 = CodeBlock(inputList=get_all_revisions) { List.GetItemAtIndex(inputList, 0..2); }
# note: Input a range of Revisions based on the numbers in the Watch list above.  Do one by one if the required Revisions are not within a close range. E.g. 0 then 2.
boolean_4 = BoolSelector(true)
add_revisions_to_sheet = Custom[Add Revisions to Sheet](Sheet=filterByBoolMask.in, Revision=code_block_2, RunIt=boolean_4)  # This node will add specified revisions to a sheet.
name = Element.Name(add_revisions_to_sheet)
# note: List of Sheets affected
sheet_name = Watch(name)
sheetNumber = Sheet.SheetNumber(add_revisions_to_sheet)
sheet_no = Watch(sheetNumber)
remove_revision_from_sheet = Custom[Remove Revision from Sheet]()  # This node will remove specified Revisions from a sheet.; unwired: Sheet, Revision
