# Dynamo graph Room Renumbering.dyn (Dynamo 0.8.1.1942)

select_model_element = DSModelElementSelection()  # 1 picked in the model
curve = CurveElement.Curve(select_model_element)
integer_slider = IntegerSlider(400, range=0..400 step 1)
divideEqually = Curve.DivideEqually(curve, integer_slider)
endPoint = Curve.EndPoint(divideEqually)
watch = Watch(endPoint)
firstItem = List.FirstItem(endPoint)
categories = Categories("Rooms")
all_elements_of_category = ElementsOfCategory(categories)
filterByBoolMask = List.FilterByBoolMask(list=all_elements_of_category)
watch_2 = Watch(filterByBoolMask.in)
watch_3 = Watch(all_elements_of_category)
boundingBox = Geometry.BoundingBox(watch_3)
contains = BoundingBox.Contains(boundingBox)
map = List.Map(list=endPoint, f_x=contains)
watch_4 = Watch(map)
count = Count()
map_2 = List.Map(list=map, f_x=filterByBoolMask.in)
integer_slider_2 = IntegerSlider(1, range=0..100 step 1)
flatten = List.Flatten(list=map_2, amt=integer_slider_2)
uniqueItems = List.UniqueItems(flatten)
string = StringInput("Number")
number = DoubleInput(100)
count_2 = List.Count(uniqueItems)
number_2 = DoubleInput(1)
number_sequence = NumberSeq(number, count_2, number_2, lacing=Longest)
string_from_object = FromObject(number_sequence)
setParameterByName = Element.SetParameterByName(element=uniqueItems, parameterName=string, value=string_from_object)
