# Dynamo graph 00 Room Renumber By Spline.dyn (Dynamo 2.3.0.5885)

# group: Select Spline
select_model_line_spline = DSModelElementSelection()  # 1 picked in the model; graph input

# group: Category to edit
# note: Inspired by https://knowledge.autodesk.com/support/revit-products/learn-explore/caas/screencast/Main/Details/f8e9b3ac-8b34-4f00-bf4a-39a4cccf284e.html
categories = Categories("OST_Rooms")  # graph input

# group: Parameter
parameter_to_write = StringInput("Number")  # graph input

# group: Prefix
prefix = StringInput("0")  # graph input

# group: Start Number
number = DoubleInput(1)  # graph input

# group: Processing
curve = CurveElement.Curve(curveElement=select_model_line_spline)
integer_slider = IntegerSlider(400, range=0..400 step 1)
pointsAtEqualSegmentLength = Curve.PointsAtEqualSegmentLength(curve=curve, divisions=integer_slider)
splitByPoints = Curve.SplitByPoints(curve=curve, points=pointsAtEqualSegmentLength)
endPoint = Curve.EndPoint(curve=splitByPoints)
all_elements_of_category = ElementsOfCategory(Category=categories)
filterByBoolMask = List.FilterByBoolMask(list=all_elements_of_category)  # unwired: mask
code_block = CodeBlock { 1; }

geometry = Element.Geometry(element=all_elements_of_category)
byGeometry = BoundingBox.ByGeometry(geom=geometry)

# group (continued): Processing
contains = BoundingBox.Contains(boundingBox=byGeometry)  # unwired: point
map = List.Map(list=endPoint, f_x=contains)
map_2 = List.Map(list=map, f_x=filterByBoolMask.in)
flatten = List.Flatten(list=map_2)
uniqueItems = List.UniqueItems(list=flatten)
count = List.Count(list=uniqueItems)
sequence = Sequence(start=number, amount=count, step=code_block, lacing=Longest)
string_from_object = FromObject(obj=sequence)
code_block_2 = CodeBlock(a=prefix, b=string_from_object) { a+b; }
setParameterByName = Element.SetParameterByName(element=uniqueItems, parameterName=parameter_to_write, value=code_block_2)
