# Dynamo graph Room Renumbering.dyn (Dynamo 2.3.0.5885)

select_model_element = DSModelElementSelection()  # 1 picked in the model
curve = CurveElement.Curve(curveElement=select_model_element)
integer_slider = IntegerSlider(400, range=0..400 step 1)
pointsAtEqualSegmentLength = Curve.PointsAtEqualSegmentLength(curve=curve, divisions=integer_slider)
splitByPoints = Curve.SplitByPoints(curve=curve, points=pointsAtEqualSegmentLength)
endPoint = Curve.EndPoint(curve=splitByPoints)
watch = Watch(endPoint)
firstItem = List.FirstItem(list=endPoint)
categories = Categories("OST_Rooms")
all_elements_of_category = ElementsOfCategory(Category=categories)
filterByBoolMask = List.FilterByBoolMask(list=all_elements_of_category)  # unwired: mask
watch_2 = Watch(filterByBoolMask.in)
watch_3 = Watch(all_elements_of_category)
boundingBox = Geometry.BoundingBox(geometry=watch_3)
contains = BoundingBox.Contains(boundingBox=boundingBox)  # unwired: point
map = List.Map(list=endPoint, f_x=contains)
watch_4 = Watch(map)
count = List.Count()  # unwired: list
map_2 = List.Map(list=map, f_x=filterByBoolMask.in)
integer_slider_2 = IntegerSlider(1, range=0..100 step 1)
flatten = List.Flatten(list=map_2, amt=integer_slider_2)
uniqueItems = List.UniqueItems(list=flatten)
string = StringInput("Number")
number = DoubleInput(100)
count_2 = List.Count(list=uniqueItems)
number_2 = DoubleInput(1)
sequence = Sequence(start=number, amount=count_2, step=number_2, lacing=Longest)
string_from_object = FromObject(obj=sequence)
setParameterByName = Element.SetParameterByName(element=uniqueItems, parameterName=string, value=string_from_object)
