# Dynamo graph Views to UpperCase.dyn (Dynamo 1.3.2.2480)

element_types = ElementTypes("View")
all_elements_of_type = ElementsOfType(element_types)
code_block = CodeBlock { "View Name"; }
getParameterValueByName = Element.GetParameterValueByName(element=all_elements_of_type, parameterName=code_block)
toUpper = String.ToUpper(getParameterValueByName)
setParameterByName = Element.SetParameterByName(element=all_elements_of_type, parameterName=code_block, value=toUpper)
categories = Categories("Sheets")
all_elements_of_category = ElementsOfCategory(categories)
code_block_2 = CodeBlock { "Sheet Name"; }
